# Grasshopper definition solar_path_reset.gh (Grasshopper 1.0.7)

series = Series(Start=-23.5, Step=23.5, Count=3)
number_slider = Slider(100, range=0..100)
P = Plane(PlaneXY(0, 0, 0))
c_script = CSharpScript(r=number_slider, LAT=Slider(20, range=-90..90), DEC=series)  # -> out, dh, ds, dt, rh, rs; inputs r: Double, LAT: Double, DEC: list of Double
# ---------- c_script: C# ----------
    //Convert degree input to radians
    double cdr = (Math.PI / 180);


    //Create ALT list, add ALT values
    List<double> ALT = new List<double>();
    ALT.Add(90 - LAT - 23.45);
    ALT.Add(90);
    ALT.Add(90 - LAT + 23.45);

    //Create rs values
    double rs1 = (r * Math.Cos(DEC[0] * cdr)) / (Math.Sin(LAT * cdr) + Math.Sin(DEC[0] * cdr));
    double rs2 = (r * Math.Cos(DEC[1] * cdr)) / (Math.Sin(LAT * cdr) + Math.Sin(DEC[1] * cdr));
    double rs3 = (r * Math.Cos(DEC[2] * cdr)) / (Math.Sin(LAT * cdr) + Math.Sin(DEC[2] * cdr));
    //Add values to rs list
    List<double> rs_input = new List<double>();
    rs_input.Add(rs1);
    rs_input.Add(rs2);
    rs_input.Add(rs3);

    //Create ds values
    double ds1 = (r * (Math.Cos(LAT * cdr))) / (Math.Sin(LAT * cdr) + Math.Sin(DEC[0] * cdr));
    double ds2 = (r * Math.Cos(LAT * cdr)) / (Math.Sin(LAT * cdr) + Math.Sin(DEC[1] * cdr));
    double ds3 = (r * (Math.Cos(LAT * cdr))) / (Math.Sin(LAT * cdr) + Math.Sin(DEC[2] * cdr));
    //Add values to ds list
    List<double> ds_input = new List<double>();
    ds_input.Add(ds1);
    ds_input.Add(ds2);
    ds_input.Add(ds3);


    //Create dt
    double dt_input = (r * Math.Tan(LAT * cdr));

    //Create HRA values
    List<int> HRA = new List<int>();
    int i = 15;
    for(i = -90; i <= 90; i += 15)
    {
      HRA.Add(i);
    }

    //Create dh
    List<double> dh_input = new List<double>();
    foreach (double hour in HRA)
    {
      double dh_values = r / ((Math.Cos(LAT * cdr)) * (Math.Tan(hour * cdr)));
      dh_input.Add(dh_values);
    }

    //Create rh
    List<double> rh_input = new List<double>();
    foreach (double hour in HRA)
    {
      double rh_values = r / ((Math.Cos(LAT * cdr)) + (Math.Sin(HRA[0] * cdr)));
      rh_input.Add(rh_values);
    }





    ds = ds_input;
    rs = rs_input;
    dh = dh_input;
    rh = rh_input;
    dt = dt_input;
# ---------- end c_script ----------
cir = Circle(Plane=P, Radius=number_slider)
panel = Panel(c_script.rs)
panel_2 = Panel(c_script.dh)
circle = CircleCNR(Center=P, Normal=Vector(0, 0, 1), Radius=panel)
pt = ConstructPoint(XCoordinate=panel_2, YCoordinate=c_script.dt, ZCoordinate=0)
Y = UnitY(Factor=c_script.ds)
arc = Arc(Plane=PlaneXY(0, 0, 0), Radius=c_script.rh, Angle=Domain(0, 3.141592654))  # -> Arc, Length
move = Move(Geometry=circle, Motion=Y)  # -> Geometry, Transform
circle_2 = CircleCNR(Center=pt, Normal=Vector(0, 0, 1), Radius=1)
